# Grasshopper definition IFCopenHouse_GeometryGym_read_IFC.gh (Grasshopper 0.9.72)

panel = Panel("C:\Documents and Settings\Ryan Schultz\My Documents\GitHub\IFCOpenHouse_Pine_Spring\IfcOpenHouse_IFC2x3.ifc")
path = FilePath(panel)
file = ReadFile(Path=path, PerLineParse=True)
ggifc = GgIFCReadFile(IFCDataStrings=file, AppendData=True)
panel_2 = Panel(file)
panel_3 = Panel(ggifc)
ggifcdp = GgIFCDecomposeProject(IFCProject=ggifc)  # -> IFCGlobalID, Name, IFCDescription, IFCRootSiteOrBuilding, LongName, Phase, IFCTypeProducts, ModelTransform
panel_4 = Panel(ggifcdp.IFCTypeProducts)
ggifcds = GgIFCDecomposeSite(IFCSite=ggifcdp.IFCRootSiteOrBuilding)  # -> Name, IFCBuildings, IFCSiteProducts, IFCDescription, IFCGlobalID
ggifcdb = GgIFCDecomposeBuilding(IFCBuilding=ggifcds.IFCBuildings)  # -> Name, IFCBuildingStories, IFCBuildingProducts, IFCDescription, IFCGlobalID
ggifcdbs = GgIFCDecomposeBuildingStorey(IFCBuildingStorey=ggifcdb.IFCBuildingStories)  # -> Name, Elevation, IFCSpaces, IFCBuildingStoreyProducts, IFCBuildingStoreyGrids, IFCDescription, IFCGlobalID
ggifcdp_2 = GgIFCDecomposeProduct(IFCProduct=ggifcdbs.IFCBuildingStoreyProducts)  # -> IFCGlobalID, Name, IFCDescription, IFCObjectTypeDescription, IFCObjectType, IFCObjectPlacement, IFCRepresentation
